# Grasshopper definition SampleGHClash.gh (Grasshopper 1.0.7)
# Sample shows how to pass meshes as input geometry to a GH Document solved on RhinoCompute.

collisionmeshes = GetGeometry(AtLeast=1, AtMost=2147483647, Filter=1074004029)
mainmesh = GetGeometry(AtLeast=1, AtMost=2147483647, Filter=1074004029)
mesh = Mesh(collisionmeshes)
mesh_2 = Mesh(mainmesh)
clash = Clash(FirstSet=mesh_2, SecondSet=mesh, Distance=0, L=100)  # -> ClashCount, ClashPoints, ClashRadii, FirstIndex, SecondIndex
item = ListItem(List=mesh, Index=clash.SecondIndex, Wrap=True)

# ---- group: RH_OUT:meshes
mesh_3 = Mesh(item)
