# Grasshopper definition delaunay.gh (Grasshopper 1.0.7)
# Sample shows how to send a list of points and get a mesh.

points = GetGeometry(AtLeast=1, AtMost=2147483647, Filter=1074004029)
pt = Point(points)
del = DelaunayMesh(Points=pt, Plane=PlaneXY(0, 0, 0))

# ---- group: RH_OUT:mesh
mesh = Mesh(del)
